# Grasshopper definition 160407_CityMatrix.gh (Grasshopper 0.9.76)
# plug-ins: Python Interpreter, gHowl, HDTReference

# ---- group: mesh coloring
com_color = ColourSwatch(SwatchColor=RGB(255, 122, 122))  # disabled
com_gray = ColourSwatch(SwatchColor=RGB(171, 171, 171))  # disabled
res_color = ColourSwatch(SwatchColor=RGB(251, 255, 122))  # disabled
mesh = Mesh([<mesh referenced from the Rhino model> x63])  # disabled
sidewalk = ColourSwatch(SwatchColor=RGB(107, 107, 107))  # disabled
bikelane = ColourSwatch(SwatchColor=RGB(47, 153, 49))  # disabled
res_gray = ColourSwatch(SwatchColor=RGB(227, 227, 227))  # disabled
parking = ColourSwatch(SwatchColor=RGB(196, 156, 100))  # disabled
blank = ColourSwatch(SwatchColor=RGB(110, 110, 110))  # disabled
road = ColourSwatch(SwatchColor=RGB(64, 64, 64))  # disabled
park = ColourSwatch(SwatchColor=RGB(170, 199, 68))  # disabled
# 3D City Grid System
text = ColourSwatch(SwatchColor=RGB(0, 0, 0))  # disabled
mcol = MeshColours(Mesh=mesh, Colours=com_gray)  # disabled
mesh_2 = Mesh(mcol)  # disabled

# ---- group: module meshes lego ref: -1
mesh_3 = Mesh(<mesh referenced from the Rhino model>)

# ---- group: module meshes lego ref: 6 line bike
mesh_4 = Mesh(<mesh referenced from the Rhino model>)

# ---- group: module meshes lego ref: 0 to 5
mesh_5 = Mesh([<mesh referenced from the Rhino model> x6])

# ---- group: module meshes lego ref: 6 line car
mesh_6 = Mesh(<mesh referenced from the Rhino model>)

# ---- group: colortizer orgin
# CityMatrix
# 
# by Yan "Ryan" Zhang <ryanz@mit.edu>
# for MIT Media Lab, Changing Place Group, CityScope Project
# March.17th.2016
# LEGO Grid System
pt = Point(<point referenced from the Rhino model>)

# ---- group: table size ref pt
pt_2 = Point(<point referenced from the Rhino model>)

# ----
panel = Panel("7002")  # disabled
# PEVs
panel_2 = Panel("127.0.0.1")  # disabled
swatch = ColourSwatch(SwatchColor=RGB(255, 255, 255))  # disabled
# Traffic Heatmap
# Energy per Capita Heatmap
panel_3 = Panel("C:\Users\RYAN\Documents\GitHub\CityMatrix\Map\PEV_PSG AND PKG_300DPI.png")  # disabled
panel_4 = Panel("0.01")  # disabled
xy = XYPlane(Origin=pt)
dist = Distance(PointA=pt, PointB=pt_2)
mesh_7 = Mesh(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)  # disabled

# ---- group: 6 intersect bike
mesh_8 = Mesh(<mesh referenced from the Rhino model>)

# ---- group: 6 intersect car
mesh_9 = Mesh(<mesh referenced from the Rhino model>)

# ----
timer = Timer(TimerInterval=500, Target=division)  # disabled

# ---- group: 3D building site move amount
X = UnitX(Factor="10000")

# ----
merge = Merge(Data1=mesh_5, Data2=mesh_4, Data3=mesh_8, Data4=mesh_3)

# ---- group: udp receiver
udp = UDPReceiver(Address=panel_2, Port=panel, Pattern=0)  # -> Info, Data; disabled

# ----
_4_commed = Slider(12, range=1..25)
_1_resmed = Slider(11, range=1..25)
_3_comhq = Slider(6, range=1..25)
_0_reslux = Slider(5, range=1..25)
_5_rescw = Slider(23, range=1..25)
_2_resmu = Slider(23, range=1..25)

# ---- group: base cplane
pln = Plane(xy)

# ----
split = TextSplit(Text=udp.Data)  # disabled

# ---- group: PEV center pt
pt_3 = Point(split)  # disabled

# ----
vec2pt = Vector2Pt(PointA=Point(0, 0, 0), PointB=pt_3, Unitize=False)  # -> Vector, Length; disabled
move = Move(Geometry=mesh_7, Motion=vec2pt.Vector)  # -> Geometry, Transform; disabled
geobottomcenter = GeoBottomCenter(geo=merge)
com = ColourSwatch(SwatchColor=RGB(145, 145, 145))
res = ColourSwatch(SwatchColor=RGB(207, 207, 207))
mjoin = MeshJoin(Meshes=move.Geometry)  # disabled
number_slider = Slider(0.95, range=0..1)
vec2pt_2 = Vector2Pt(PointA=geobottomcenter, PointB=Point(0, 0, 0), Unitize=False)  # -> Vector, Length
merge_2 = Merge(Data1=_0_reslux, Data2=_1_resmed, Data3=_2_resmu, Data4=_3_comhq, Data5=_4_commed, Data6=_5_rescw)
merge_3 = Merge(Data1=res, Data2=res, Data3=res, Data4=com, Data5=com, Data6=com)

# ---- group: PEVs
previewmat = CustomPreviewMaterials(Geometry=mjoin, DiffuseColor=swatch, Transparency=panel_4, DiffuseBitmap=panel_3)  # disabled

# ----
move_2 = Move(Geometry=merge, Motion=vec2pt_2.Vector)  # -> Geometry, Transform

# ---- group: color for each type
col = Colour(merge_3)

# ---- group: floor num for each type
int = Integer(merge_2)

# ---- group: floor height
panel_5 = Panel("3.5")

# ----
scale_nu = ScaleNU(Geometry=move_2.Geometry, Plane=PlaneXY(0, 0, 0), ScaleX=number_slider, ScaleY=number_slider, ScaleZ=1)  # -> Geometry, Transform
multiplication = Multiplication(A=int, B=panel_5)
mesh_10 = Mesh(scale_nu.Geometry)

# ---- group: base height
panel_6 = Panel("5.0")

# ---- group: building height for each type
num = Number(multiplication)

# ---- group: module meshes lego at orgin
mesh_11 = Mesh(mesh_10)

# ----
panel_7 = Panel(num)
panel_8 = Panel("C:\Users\RYAN\Documents\GitHub\CityMatrix\Data\colortizer_data_rhino_02_YZ.txt")
panel_9 = Panel("C:\Users\RYAN\Documents\GitHub\CityMatrix\Data\colortizer_data_rhino_01_YZ.txt")
# Parsing Colortizer Data (CityMatrix 16x16)
panel_10 = Panel("C:\Users\RYAN\Documents\GitHub\CityMatrix\Data\colortizer_data.txt")

# ---- group: udp receiver
udp_2 = UDPReceiver(Address="127.0.0.1", Port="7001", Pattern=0)  # -> Info, Data

# ----
split_2 = TextSplit(Text=udp_2.Data)

# ---- group: reading txt
file = ReadFile(File=panel_8, PerLineParse=True)

# ---- group: colortizer data
txt = Text(file)

# ----
panel_11 = Panel(txt)
split_3 = SplitList(List=txt, Index=9)  # -> ListA, ListB
pshift = ShiftPaths(Data=split_3.ListB, Offset=-1)
pshift_2 = ShiftPaths(Data=split_3.ListA, Offset=-1)
item = ListItem(List=pshift_2, Index=4, Wrap=False)
item_2 = ListItem(List=pshift_2, Index=2, Wrap=False)
item_3 = ListItem(List=pshift_2, Index=3, Wrap=False)
item_4 = ListItem(List=pshift_2, Index=5, Wrap=False)
item_5 = ListItem(List=pshift_2, Index=6, Wrap=False)
item_6 = ListItem(List=pshift_2, Index=7, Wrap=False)
item_7 = ListItem(List=pshift_2, Index=1, Wrap=False)
item_8 = ListItem(List=pshift_2, Index=0, Wrap=False)
item_9 = ListItem(List=pshift_2, Index=8, Wrap=False)
split_4 = TextSplit(Text=item, Separators="\t")
split_5 = TextSplit(Text=item_2, Separators="\t")
split_6 = TextSplit(Text=item_3, Separators="\t")
split_7 = TextSplit(Text=item_4, Separators="\t")
split_8 = TextSplit(Text=item_5, Separators="\t")
split_9 = TextSplit(Text=item_6, Separators="\t")
split_10 = TextSplit(Text=item_7, Separators="\t")
split_11 = TextSplit(Text=item_8, Separators="\t")
split_12 = TextSplit(Text=item_9, Separators="\t")
pshift_3 = ShiftPaths(Data=split_4, Offset=1)
pshift_4 = ShiftPaths(Data=split_5, Offset=1)
pshift_5 = ShiftPaths(Data=split_6, Offset=1)
pshift_6 = ShiftPaths(Data=split_7, Offset=1)
pshift_7 = ShiftPaths(Data=split_8, Offset=1)
pshift_8 = ShiftPaths(Data=split_9, Offset=1)
pshift_9 = ShiftPaths(Data=split_10, Offset=1)
pshift_10 = ShiftPaths(Data=split_11, Offset=1)
pshift_11 = ShiftPaths(Data=split_12, Offset=1)
item_10 = ListItem(List=pshift_3, Index=0, Wrap=False)
item_11 = ListItem(List=pshift_4, Index=0, Wrap=False)
item_12 = ListItem(List=pshift_5, Index=0, Wrap=False)
item_13 = ListItem(List=pshift_6, Index=0, Wrap=False)
item_14 = ListItem(List=pshift_7, Index=0, Wrap=False)
item_15 = ListItem(List=pshift_8, Index=0, Wrap=False)
item_16 = ListItem(List=pshift_9, Index=0, Wrap=False)
item_17 = ListItem(List=pshift_10, Index=0, Wrap=False)
item_18 = ListItem(List=pshift_11, Index=0, Wrap=False)
txt_2 = Text(item_10)
txt_3 = Text(item_11)
txt_4 = Text(item_12)
txt_5 = Text(item_13)
txt_6 = Text(item_14)
txt_7 = Text(item_15)
txt_8 = Text(item_16)
txt_9 = Text(item_17)
txt_10 = Text(item_18)
panel_12 = Panel(txt_2)
panel_13 = Panel(txt_3)
panel_14 = Panel(txt_4)
panel_15 = Panel(txt_5)
panel_16 = Panel(txt_6)
panel_17 = Panel(txt_7)
panel_18 = Panel(txt_8)
panel_19 = Panel(txt_9)
panel_20 = Panel(txt_10)
item_19 = ListItem(List=pshift_3, Index=1, Wrap=False)

# ---- group: dockRotation
int_2 = Integer(item_19)

int_3 = Integer(item_19)

# ----
item_20 = ListItem(List=pshift_4, Index=1, Wrap=False)
item_21 = ListItem(List=pshift_5, Index=1, Wrap=False)

# ---- group: dockID
int_4 = Integer(item_21)

int_5 = Integer(item_21)

# ----
item_22 = ListItem(List=pshift_6, Index=1, Wrap=False)

# ---- group: slider1
num_2 = Number(item_22)

num_3 = Number(item_22)

# ----
item_23 = ListItem(List=pshift_7, Index=1, Wrap=False)

# ---- group: toggle1
bool = Boolean(item_23)

bool_2 = Boolean(item_23)

# ----
item_24 = ListItem(List=pshift_8, Index=1, Wrap=False)

# ---- group: toggle2
bool_3 = Boolean(item_24)

bool_4 = Boolean(item_24)

# ----
item_25 = ListItem(List=pshift_9, Index=1, Wrap=False)

# ---- group: gridExtent_x
int_6 = Integer(item_25)

int_7 = Integer(item_25)

# ----
division = Division(A=dist, B=int_6)

# ---- group: cell size
num_4 = Number(division)

num_5 = Number(division)

# ----
division_2 = Division(A=num_5, B=2)
multiplication_2 = Multiplication(A=division_2, B=Slider(0.95, range=0..1))
neg = Negative(Value=multiplication_2)
dom = ConstructDomain(DomainStart=neg, DomainEnd=multiplication_2)

# ---- group: gridExtent_x
# Dashboard
int_8 = Integer(item_25)

# ----
item_26 = ListItem(List=pshift_10, Index=1, Wrap=False)
item_27 = ListItem(List=pshift_11, Index=1, Wrap=False)

# ---- group: toggle2
bool_5 = Boolean(item_27)

# Human Interaction
# Parking
bool_6 = Boolean(item_27)

# ---- group: dockRotation
int_9 = Integer(item_19)

# ---- group: IDMax
int_10 = Integer(item_20)

# ---- group: dockID
int_11 = Integer(item_21)

# ---- group: slider1
num_6 = Number(item_22)

# ---- group: toggle1
bool_7 = Boolean(item_23)

# ---- group: toggle2
bool_8 = Boolean(item_24)

# ---- group: gridExtent_x
int_12 = Integer(item_25)

# ---- group: gridIndex
int_13 = Integer(item_26)

# ---- group: toggle2
bool_9 = Boolean(item_27)

# ----
panel_21 = Panel(int_9)
panel_22 = Panel(int_10)
panel_23 = Panel(int_11)
panel_24 = Panel(num_6)
panel_25 = Panel(bool_7)
panel_26 = Panel(bool_8)
panel_27 = Panel(int_12)
panel_28 = Panel(int_13)
panel_29 = Panel(bool_9)
item_28 = ListItem(List=pshift_9, Index=2, Wrap=False)

# ---- group: gridExtent_y
int_14 = Integer(item_28)

int_15 = Integer(item_28)

int_16 = Integer(item_28)

int_17 = Integer(item_28)

# ----
panel_30 = Panel(int_17)
multiplication_3 = Multiplication(A=int_12, B=int_17)
split_13 = SplitList(List=pshift, Index=multiplication_3)  # -> ListA, ListB
pshift_12 = ShiftPaths(Data=split_13.ListA, Offset=-1)
split_14 = TextSplit(Text=pshift_12, Separators="\t")
pshift_13 = ShiftPaths(Data=split_14, Offset=1)

# ---- group: all data
int_18 = Integer(pshift_13)

# ----
panel_31 = Panel(int_18)  # disabled
item_29 = ListItem(List=int_18, Index="3", Wrap=False)
item_30 = ListItem(List=int_18, Index="0", Wrap=False)
item_31 = ListItem(List=int_18, Index="1", Wrap=False)
item_32 = ListItem(List=int_18, Index="2", Wrap=False)
pshift_14 = ShiftPaths(Data=item_30, Offset=-1)
pshift_15 = ShiftPaths(Data=item_31, Offset=-1)
pshift_16 = ShiftPaths(Data=item_32, Offset=-1)
pshift_17 = ShiftPaths(Data=item_29, Offset=-1)

# ---- group: x
int_19 = Integer(pshift_15)

int_20 = Integer(int_19)

int_21 = Integer(int_19)

int_22 = Integer(int_19)

# ---- group: module id
int_23 = Integer(pshift_14)

int_24 = Integer(int_23)

int_25 = Integer(int_23)

# ----
larger = LargerThan(FirstNumber=int_24, SecondNumber="0")  # -> LargerThan, OrEqualTo
smaller = SmallerThan(FirstNumber=int_24, SecondNumber="5")  # -> SmallerThan, OrEqualTo
larger_2 = LargerThan(FirstNumber=int_24, SecondNumber="5")  # -> LargerThan, OrEqualTo
smaller_2 = SmallerThan(FirstNumber=int_24, SecondNumber="0")  # -> SmallerThan, OrEqualTo
and = GateAnd(A=larger.OrEqualTo, B=smaller.OrEqualTo)
or = GateOr(A=larger_2.LargerThan, B=smaller_2.SmallerThan)

# ---- group: is building or not
bool_10 = Boolean(and)

# ---- group: is road/blank or not
bool_11 = Boolean(or)

# ----
dispatch = Dispatch(List=int_24, DispatchPattern=bool_10)  # -> ListA, ListB

# ---- group: building id
int_26 = Integer(dispatch.ListA)

# ----
item_33 = ListItem(List=col, Index=graft(int_26), Wrap=False)
pshift_18 = ShiftPaths(Data=item_33, Offset=-1)
item_34 = ListItem(List=mesh_11, Index=graft(int_25), Wrap=Toggle(True))

# ---- group: color for each building
col_2 = Colour(pshift_18)

# ----
item_35 = ListItem(List=panel_7, Index=graft(int_26), Wrap=False)
pshift_19 = ShiftPaths(Data=item_34, Offset=-1)
pshift_20 = ShiftPaths(Data=item_35, Offset=-1)

# ---- group: selected meshes
mesh_12 = Mesh(pshift_19)

# ---- group: building height of each building
num_7 = Number(pshift_20)

# ----
addition = Addition(A=num_7, B=panel_6)
dom_2 = ConstructDomain(DomainStart=0, DomainEnd=addition)

# ---- group: module id
int_27 = Integer(int_23)

# ---- group: y
int_28 = Integer(pshift_16)

int_29 = Integer(int_28)

int_30 = Integer(int_28)

# ----
modulecenter = ModuleCenter(pt=pt, num=num_4, int_2=int_21, int=int_30)  # -> pt_5, transform_2
xform = Transform(modulecenter.transform_2)  # disabled

# ---- group: module center
pt_4 = Point(modulecenter.pt_5)

pt_5 = Point(pt_4)

# ----
dispatch_2 = Dispatch(List=pt_5, DispatchPattern=bool_10)  # -> ListA, ListB

# ---- group: building center
pt_6 = Point(dispatch_2.ListA)

# ----
vec2pt_3 = Vector2Pt(PointA=Point(0, 0, 0), PointB=pt_4, Unitize=False)  # -> Vector, Length
move_3 = Move(Motion=vec2pt_3.Vector)  # -> Geometry, Transform
pshift_21 = ShiftPaths(Data=move_3.Transform, Offset=-1)
box = DomainBox(Base=pt_6, X=dom, Y=dom, Z=dom_2)
graft = GraftTree(Tree=pshift_21, IncludeEmptyLists=True, IncludeNullItems=True)
move_4 = Move(Geometry=box, Motion=X)  # -> Geometry, Transform

# ---- group: building geo
box_2 = Box(move_4.Geometry)

# ---- group: textured buildings
panel_32 = Panel("C:\Users\RYAN\Documents\GitHub\CityMatrix\Map\PEV_PSG AND PKG_300DPI.png")  # disabled
panel_33 = Panel("0.01")  # disabled
swatch_2 = ColourSwatch(SwatchColor=RGB(255, 255, 255))  # disabled
boxmap = BoxMapping(Mesh=box_2, Box=box_2)  # disabled
previewmat_2 = CustomPreviewMaterials(Geometry=boxmap, DiffuseColor=swatch_2, Transparency=panel_33, DiffuseBitmap=panel_32)  # disabled

# ---- group: 3D Buldings
preview = CustomPreview(Geometry=box_2, Shader=col_2)

# ---- group: y
int_31 = Integer(int_28)

# ---- group: rotation
int_32 = Integer(pshift_17)

int_33 = Integer(int_32)

int_34 = Integer(int_32)

# ----
rotate = Rotate(Angle=degrees(int_34), Plane=PlaneXY(0, 0, 0))  # -> Geometry, Transform
graft_2 = GraftTree(Tree=rotate.Transform, IncludeEmptyLists=True, IncludeNullItems=True)
comp = Compound(Transforms=[graft_2, graft])
pshift_22 = ShiftPaths(Data=comp, Offset=-1)
transform = Transform(Geometry=mesh_12, Transform=pshift_22)

# ---- group: lego modules
mesh_13 = Mesh(transform)

mesh_14 = Mesh(mesh_13)

# ----
dispatch_3 = Dispatch(List=mesh_14, DispatchPattern=bool_11)  # -> ListA, ListB
move_5 = Move(Geometry=dispatch_3.ListA, Motion=X)  # -> Geometry, Transform

# ---- group: road/blank
mesh_15 = Mesh(move_5.Geometry)

# ---- group: rotation
int_35 = Integer(int_32)

# ----
panel_34 = Panel(int_19)  # disabled
panel_35 = Panel(int_28)  # disabled
panel_36 = Panel(int_32)  # disabled
panel_37 = Panel(int_23)  # disabled

# ---- group: total cell #
int_36 = Integer(multiplication_3)

# ----
panel_38 = Panel(int_36)

# ---- group: sticky rotations
python = PythonScript(x=int_32)  # -> out, rotations; inputs x: list; disabled
# ---------- python: Python ----------
"""
Realtime Simulator

written by Yan "Ryan" Zhang <ryanz@mit.edu>
for MIT Media Lab, Changing Place Group, CityScope Project
March.7th.2016
"""

import scriptcontext as sc

sc.sticky["rotations"] = x

rotations = sc.sticky["rotations"]
# ---------- end python ----------

# ---- group: sticky y steps
python_2 = PythonScript(x=int_28)  # -> out, ySteps; inputs x: list; disabled
# ---------- python_2: Python ----------
"""
Realtime Simulator

written by Yan "Ryan" Zhang <ryanz@mit.edu>
for MIT Media Lab, Changing Place Group, CityScope Project
March.7th.2016
"""

import scriptcontext as sc

sc.sticky["ySteps"] = x

ySteps = sc.sticky["ySteps"]
# ---------- end python_2 ----------

# ---- group: sticky moduleIDs
python_3 = PythonScript(x=int_23)  # -> out, moduleIDs; inputs x: list; disabled
# ---------- python_3: Python ----------
"""
Realtime Simulator

written by Yan "Ryan" Zhang <ryanz@mit.edu>
for MIT Media Lab, Changing Place Group, CityScope Project
March.7th.2016
"""

import scriptcontext as sc

sc.sticky["moduleIDs"] = x

moduleIDs = sc.sticky["moduleIDs"]
# ---------- end python_3 ----------

# ---- group: sticky x steps
python_4 = PythonScript(x=int_19)  # -> out, xSteps; inputs x: list; disabled
# ---------- python_4: Python ----------
"""
Realtime Simulator

written by Yan "Ryan" Zhang <ryanz@mit.edu>
for MIT Media Lab, Changing Place Group, CityScope Project
March.7th.2016
"""

import scriptcontext as sc

sc.sticky["xSteps"] = x

xSteps = sc.sticky["xSteps"]
# ---------- end python_4 ----------

# ----
panel_39 = Panel(python.rotations)  # disabled
panel_40 = Panel(python.out)  # disabled
panel_41 = Panel(python_2.ySteps)  # disabled
panel_42 = Panel(python_2.out)  # disabled
panel_43 = Panel(python_4.xSteps)  # disabled
panel_44 = Panel(python_4.out)  # disabled
panel_45 = Panel(python_3.moduleIDs)  # disabled
panel_46 = Panel(python_3.out)  # disabled

# ==== cluster ModuleCenter
pt = ClusterInput()
int = ClusterInput()
num = ClusterInput()
int_2 = ClusterInput()

# ---- group: y
int_3 = Integer(int)

# ---- group: cell size
num_2 = Number(num)

# ---- group: x
int_4 = Integer(int_2)

# ---- group: center
pt_2 = Point(pt)

# ----
pt_3 = ConstructPoint(XCoordinate=0, YCoordinate=0, ZCoordinate=0)  # disabled
addition = Addition(A=int_4, B=0.5)
vec2pt = Vector2Pt(PointA=pt_3, PointB=pt_2, Unitize=False)  # -> Vector, Length; disabled
addition_2 = Addition(A=int_3, B=0.5)
multiplication = Multiplication(A=addition, B=num_2)
lng = ListLength(List=int_4)  # disabled
move = Move(Motion=vec2pt.Vector)  # -> Geometry, Transform; disabled
multiplication_2 = Multiplication(A=addition_2, B=num_2)
X = UnitX(Factor=multiplication)
repeat = RepeatData(Data=move.Transform, Length=lng)  # disabled
neg = Negative(Value=multiplication_2)
move_2 = Move(Geometry=pt_2, Motion=X)  # -> Geometry, Transform
graft = GraftTree(Tree=move_2.Transform, IncludeEmptyLists=True, IncludeNullItems=True)  # disabled
Y = UnitY(Factor=neg)
pshift = ShiftPaths(Data=repeat, Offset=-1)  # disabled
move_3 = Move(Geometry=move_2.Geometry, Motion=Y)  # -> Geometry, Transform
graft_2 = GraftTree(Tree=move_3.Transform, IncludeEmptyLists=True, IncludeNullItems=True)  # disabled
comp = Compound(Transforms=[graft, graft_2])  # disabled
graft_3 = GraftTree(Tree=pshift, IncludeEmptyLists=True, IncludeNullItems=True)  # disabled
comp_2 = Compound(Transforms=[comp, graft_3])  # disabled

# ---- group: module center
pt_4 = Point(move_3.Geometry)

# ----
pshift_2 = ShiftPaths(Data=comp_2, Offset=-1)  # disabled
transform = Transform(pshift_2)  # disabled
pt_5 = ClusterOutput(pt_4)
transform_2 = ClusterOutput(transform)  # disabled

# ==== cluster GeoBottomCenter
geo = ClusterInput()
geo_2 = Geometry(geo)
bbox = BoundingBox(Content=geo_2, Plane=PlaneXY(0, 0, 0))  # -> Box, Box_2
box_corners = BoxCorners(Box=bbox.Box)  # -> CornerA, CornerB, CornerC, CornerD, CornerE, CornerF, CornerG, CornerH
pdecon = Deconstruct(Point=box_corners.CornerA)  # -> XComponent, YComponent, ZComponent
pdecon_2 = Deconstruct(Point=box_corners.CornerC)  # -> XComponent, YComponent, ZComponent
addition = Addition(A=pdecon.XComponent, B=pdecon_2.XComponent)
addition_2 = Addition(A=pdecon.YComponent, B=pdecon_2.YComponent)
division = Division(A=addition, B=2)
division_2 = Division(A=addition_2, B=2)
pt = ConstructPoint(XCoordinate=division, YCoordinate=division_2, ZCoordinate=pdecon.ZComponent)
pt_2 = Point(pt)
pt_3 = ClusterOutput(pt_2)
